% Simulink data dictionary DLBattery.sldd

PlntDLBattCapInit = 2.88
PlntDLBattChrgMax = 3.153
PlntDLBattNeuralODE = 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
PlntDLBattNumCellPar = 47
PlntDLBattNumCellSer = 96
PlntDLBatt_CellNomVolt = 3.75
PlntDLBatt_InitialTemp = 298.15
PlntDLBatt_muInput = [0.3870427 0.4800528]
PlntDLBatt_muOutput = [348.3982 299.1206]
PlntDLBatt_sigInput = [178.4899 0.2099941]
PlntDLBatt_sigOutput = [26.92599 6.293403]