% Simulink data dictionary Driver.sldd

DriverInitialGear = 0
DriverPositionGainR = 0.25
DriverDelayGain = 0.01
DriverYawRateGain = 0.2
DriverPositionGainF = 6
DriverShiftTime = 0.1
DriverWheelRange = 1.0472
DriverTimeConst = 0.3
DriverFrontCornerStiff = 40000
DriverRearCornerStiff = 40000
DriverAeroRes = 0.5
DriverRollRes = 200
DriverTractiveForce = 15000
DriverDrivelineRes = 75
DriverPreviewDist = 4