% Simulink data dictionary ElectricMachine2.sldd

PlntEM2TimeCnst = 0.02
PlntEM2ExtSplySerRes = 0
PlntEM2RotInertia = 0.01
PlntEM2RotInitSpd = 0
PlntEM2PwrLossTbl = reshape([1 1 1 1 1 1 1 1 1 1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], 19, 17, 5, 3)
PlntEM2EffPwrLossTempBpt = Simulink.Parameter([233.15 293.15 363.15])
PlntEM2TempPwrLoss = [233.15 293.15 363.15]
PlntEM2EffPwrLossSpdBpt = [0 85.5473 171.0946 256.6419 342.1893 427.7366 466.6312 513.2839 598.8312 684.3785 769.9258 855.4731 941.0204 1026.5678]
PlntEM2EffPwrLossTrqBpt = [0 22.5 45 67.5 90 112.5 135 157.5 180 202.5 225]

PlntEM2MaxTqTbl = Simulink.Parameter([225 225 225 225 225
 225 225 225 225 225
 225 225 225 225 225
 225 225 225 225 225
 225 225 225 225 225
 188.895 188.895 188.895 188.895 188.895
 151.12 151.12 151.12 151.12 151.12
 125.93 125.93 125.93 125.93 125.93
 107.94 107.94 107.94 107.94 107.94
 94.45 94.45 94.45 94.45 94.45
 83.955 83.955 83.955 83.955 83.955
 75.56 75.56 75.56 75.56 75.56
 68.69 68.69 68.69 68.69 68.69
 62.965 62.965 62.965 62.965 62.965])

PlntEM2MaxTqSpdBpt = Simulink.Parameter([0 85.5473 171.0946 256.6419 342.1893 427.7366 466.6312 513.2839 598.8312 684.3785 769.9258 855.4731 941.0204 1026.5678])

PlntEM2MinTqTbl = Simulink.Parameter([-225 -225 -225 -225 -225
 -225 -225 -225 -225 -225
 -225 -225 -225 -225 -225
 -225 -225 -225 -225 -225
 -225 -225 -225 -225 -225
 -188.895 -188.895 -188.895 -188.895 -188.895
 -151.12 -151.12 -151.12 -151.12 -151.12
 -125.93 -125.93 -125.93 -125.93 -125.93
 -107.94 -107.94 -107.94 -107.94 -107.94
 -94.45 -94.45 -94.45 -94.45 -94.45
 -83.955 -83.955 -83.955 -83.955 -83.955
 -75.56 -75.56 -75.56 -75.56 -75.56
 -68.69 -68.69 -68.69 -68.69 -68.69
 -62.965 -62.965 -62.965 -62.965 -62.965])

PlntEM2MinTqSpdBpt = Simulink.Parameter([0 85.5473 171.0946 256.6419 342.1893 427.7366 466.6312 513.2839 598.8312 684.3785 769.9258 855.4731 941.0204 1026.5678])
PlntEM2Spd = [0 85.5473 171.0946 256.6419 342.1893 427.7366 466.6312 513.2839 598.8312 684.3785 769.9258 855.4731 941.0204 1026.5678]
PlntEM2Trq = [225 225 225 225 225 225 225 204.5 175.4 153.4 136.4 122.7 111.6 102.3]
PlntEM2SpdEff = [0 85.5473 171.0946 256.6419 342.1893 427.7366 466.6312 513.2839 598.8312 684.3785 769.9258 855.4731 941.0204 1026.5678]
PlntEM2TrqEff = [0 22.5 45 67.5 90 112.5 135 157.5 180 202.5 225]
PlntEM2SpdLoss = [0 85.5473 171.0946 256.6419 342.1893 427.7366 466.6312 513.2839 598.8312 684.3785 769.9258 855.4731 941.0204 1026.5678]
PlntEM2TrqLoss = [0 22.5 45 67.5 90 112.5 135 157.5 180 202.5 225]

PlntEM2LossTbl = [0 0 0 0 0 0 0 0 0 0 0
 0 542.9 962.4 1267.6 1690.1 2406 3257.4 3800.3 4862.7 6086.6 8249.2
 0 1085.8 1466.5 1880.1 2506.7 3133.4 3760.1 5132.8 5866.1 7605.4 8450.4
 0 1443.6 1880.1 2820.1 3149.7 3937.1 4724.5 6580.2 7520.2 9899 10998.9
 0 1924.8 2506.7 3149.7 4199.6 5249.5 6299.4 7349.3 10026.9 11280.3 12533.7
 0 2406 3133.4 3937.1 4277.4 5346.7 6416 7485.4 10499 11811.4 13123.7
 0 2304.7 2863.4 3499.7 4153.5 5191.9 5477.8 6390.8 7303.8 9345.4 10383.8
 0 2535.1 3149.7 3426.6 4568.8 5021.3 5215.6 6084.9 6954.2 7823.4 8692.7
 0 2566.4 2994.2 3514.9 4686.5 5070.7 6084.9 7099 8113.2 9127.3 10141.5
 0 2506.7 3045.9 3477.1 4636.1 5795.1 6954.2 8113.2 9272.2 10431.3 11590.3
 0 2820.1 3426.6 3911.7 5215.6 6519.5 7823.4 9127.3 10431.3 11735.2 13039.1
 0 3133.4 3347.5 4346.4 5795.1 7243.9 8692.7 10141.5 11590.3 13039.1 14487.9
 0 3446.8 3682.3 4781 6374.7 7968.3 9562 11155.6 12749.3 14343 15936.6
 0 3760.1 4568.8 5215.6 6954.2 8692.7 10431.3 12169.8 13908.3 15646.9 17385.4]

PlntEM2LossesTbl4d = reshape([0 0 0 0 0 0 0 0 0 0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], 11, 14, 5, 3)
PlntEM2RotDamp = 0

PlntEM2EffTbl = [50 78 80 82 82 80 78 78 76 74 70
 52 78 80 82 82 80 78 78 76 74 70
 52 78 84 86 86 86 86 84 84 82 82
 52 80 86 86 88 88 88 86 86 84 84
 52 80 86 88 88 88 88 88 86 86 86
 52 80 86 88 90 90 90 90 88 88 88
 52 82 88 90 91 91 92 92 92 91 91
 52 82 88 91 91 92 93 93 93 93 93
 52 84 90 92 92 93 93 93 93 93 93
 62 86 91 93 93 93 93 93 93 93 93
 66 86 91 93 93 93 93 93 93 93 93
 70 86 92 93 93 93 93 93 93 93 93
 70 86 92 93 93 93 93 93 93 93 93
 72 86 91 93 93 93 93 93 93 93 93]

PlntEM2EffTbl4d = Simulink.Parameter(reshape([50 78 80 82 82 80 78 78 76 74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], 11, 14, 5, 3))
PlntEM2MaxTqVoltBpt = Simulink.Parameter([100 162.5 225 287.5 350])
PlntEM2MinTqVoltBpt = Simulink.Parameter([100 162.5 225 287.5 350])
PlntEM2EffPwrLossVoltBpt = Simulink.Parameter([100 162.5 225 287.5 350])
PlntEM2VPwrLoss = [100 162.5 225 287.5 350]