% Simulink data dictionary ElectricMachine3.sldd

PlntEM3ExtSplySerRes = 0
PlntEM3RotInertia = 0.01
PlntEM3RotInitSpd = 0
PlntEM3TimeCnst = 0.02
PlntEM3EffPwrLossTempBpt = Simulink.Parameter([233.15 293.15 363.15])
PlntEM3TempPwrLoss = [233.15 293.15 363.15]
PlntEM3EffPwrLossSpdBpt = [0 85.5473 171.0946 256.6419 342.1893 427.7366 466.6312 513.2839 598.8312 684.3785 769.9258 855.4731 941.0204 1026.5678]
PlntEM3EffPwrLossTrqBpt = [0 15 30 45 60 75 90 105 120 135 150]

PlntEM3MaxTqTbl = Simulink.Parameter([150 150 150 150 150
 150 150 150 150 150
 150 150 150 150 150
 150 150 150 150 150
 150 150 150 150 150
 125.93 125.93 125.93 125.93 125.93
 100.7467 100.7467 100.7467 100.7467 100.7467
 83.95333 83.95333 83.95333 83.95333 83.95333
 71.96 71.96 71.96 71.96 71.96
 62.96667 62.96667 62.96667 62.96667 62.96667
 55.97 55.97 55.97 55.97 55.97
 50.37333 50.37333 50.37333 50.37333 50.37333
 45.79333 45.79333 45.79333 45.79333 45.79333
 41.97667 41.97667 41.97667 41.97667 41.97667])

PlntEM3MaxTqSpdBpt = Simulink.Parameter([0 85.5473 171.0946 256.6419 342.1893 427.7366 466.6312 513.2839 598.8312 684.3785 769.9258 855.4731 941.0204 1026.5678])

PlntEM3MinTqTbl = Simulink.Parameter([-150 -150 -150 -150 -150
 -150 -150 -150 -150 -150
 -150 -150 -150 -150 -150
 -150 -150 -150 -150 -150
 -150 -150 -150 -150 -150
 -125.93 -125.93 -125.93 -125.93 -125.93
 -100.7467 -100.7467 -100.7467 -100.7467 -100.7467
 -83.95333 -83.95333 -83.95333 -83.95333 -83.95333
 -71.96 -71.96 -71.96 -71.96 -71.96
 -62.96667 -62.96667 -62.96667 -62.96667 -62.96667
 -55.97 -55.97 -55.97 -55.97 -55.97
 -50.37333 -50.37333 -50.37333 -50.37333 -50.37333
 -45.79333 -45.79333 -45.79333 -45.79333 -45.79333
 -41.97667 -41.97667 -41.97667 -41.97667 -41.97667])

PlntEM3MinTqSpdBpt = Simulink.Parameter([0 85.5473 171.0946 256.6419 342.1893 427.7366 466.6312 513.2839 598.8312 684.3785 769.9258 855.4731 941.0204 1026.5678])
PlntEM3Spd = [0 85.5473 171.0946 256.6419 342.1893 427.7366 466.6312 513.2839 598.8312 684.3785 769.9258 855.4731 941.0204 1026.5678]
PlntEM3Trq = [150 150 150 150 150 150 150 136.4 116.9 102.3 90.9 81.8 74.4 68.2]
PlntEM3SpdEff = [0 85.5473 171.0946 256.6419 342.1893 427.7366 466.6312 513.2839 598.8312 684.3785 769.9258 855.4731 941.0204 1026.5678]
PlntEM3TrqEff = [0 15 30 45 60 75 90 105 120 135 150]
PlntEM3SpdLoss = [0 85.5473 171.0946 256.6419 342.1893 427.7366 466.6312 513.2839 598.8312 684.3785 769.9258 855.4731 941.0204 1026.5678]
PlntEM3TrqLoss = [0 15 30 45 60 75 90 105 120 135 150]

PlntEM3LossTbl = [0 0 0 0 0 0 0 0 0 0 0
 0 361.9 641.6 845 1126.7 1604 2171.6 2533.5 3241.8 4057.7 5499.5
 0 723.9 977.7 1253.4 1671.2 2088.9 2506.7 3421.9 3910.7 5070.2 5633.6
 0 962.4 1253.4 1880.1 2099.8 2624.7 3149.7 4386.8 5013.5 6599.4 7332.6
 0 1283.2 1671.2 2099.8 2799.7 3499.7 4199.6 4899.5 6684.6 7520.2 8355.8
 0 1604 2088.9 2624.7 2851.6 3564.5 4277.4 4990.3 6999.3 7874.2 8749.2
 0 1536.5 1908.9 2333.2 2769 3461.3 3651.9 4260.5 4869.2 6230.3 6922.6
 0 1690.1 2099.8 2284.4 3045.9 3347.5 3477.1 4056.6 4636.1 5215.6 5795.1
 0 1710.9 1996.1 2343.3 3124.3 3380.5 4056.6 4732.7 5408.8 6084.9 6761
 0 1671.2 2030.6 2318.1 3090.7 3863.4 4636.1 5408.8 6181.5 6954.2 7726.9
 0 1880.1 2284.4 2607.8 3477.1 4346.4 5215.6 6084.9 6954.2 7823.4 8692.7
 0 2088.9 2231.7 2897.6 3863.4 4829.3 5795.1 6761 7726.9 8692.7 9658.6
 0 2297.8 2454.8 3187.3 4249.8 5312.2 6374.7 7437.1 8499.5 9562 10624.4
 0 2506.7 3045.9 3477.1 4636.1 5795.1 6954.2 8113.2 9272.2 10431.3 11590.3]

PlntEM3LossesTbl4d = reshape([0 0 0 0 0 0 0 0 0 0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], 11, 14, 5, 3)
PlntEM3RotDamp = 0

PlntEM3EffTbl = [50 78 80 82 82 80 78 78 76 74 70
 52 78 80 82 82 80 78 78 76 74 70
 52 78 84 86 86 86 86 84 84 82 82
 52 80 86 86 88 88 88 86 86 84 84
 52 80 86 88 88 88 88 88 86 86 86
 52 80 86 88 90 90 90 90 88 88 88
 52 82 88 90 91 91 92 92 92 91 91
 52 82 88 91 91 92 93 93 93 93 93
 52 84 90 92 92 93 93 93 93 93 93
 62 86 91 93 93 93 93 93 93 93 93
 66 86 91 93 93 93 93 93 93 93 93
 70 86 92 93 93 93 93 93 93 93 93
 70 86 92 93 93 93 93 93 93 93 93
 72 86 91 93 93 93 93 93 93 93 93]

PlntEM3EffTbl4d = Simulink.Parameter(reshape([50 78 80 82 82 80 78 78 76 74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], 11, 14, 5, 3))
PlntEM3MaxTqVoltBpt = Simulink.Parameter([100 162.5 225 287.5 350])
PlntEM3MinTqVoltBpt = Simulink.Parameter([100 162.5 225 287.5 350])
PlntEM3EffPwrLossVoltBpt = Simulink.Parameter([100 162.5 225 287.5 350])
PlntEM3VPwrLoss = [100 162.5 225 287.5 350]