% Simulink data dictionary HevPxVCU.sldd

CtrlVcuHevPxECMSKi = 0.1
CtrlVcuHevPxECMSKp = 3
CtrlVcuHevPxECMSmethod = 1
CtrlVcuHevPxEngTrqMin = [0 6.478395 6.81038 6.987249 7.210808 7.41443 7.608715 7.788365 7.961072 8.105103 8.24672 8.364697 8.496744 8.620051 8.747157 8.88039]
CtrlVcuHevPxHEVEngTrqMin = 16.1861
CtrlVcuHevPxNgrid = 200
CtrlVcuHevPxPenaltyFctr = 10000000
CtrlVcuHevPxSOCmax = 80
CtrlVcuHevPxSOCmin = 40
CtrlVcuHevPxSOCTrgt = 60
CtrlVcuHevPxPnltyFctr = 3
CtrlVcuHevPxChrgLmtBpt = [1 1 1 1 1 1 1 0.9 0.7 0.5 0]
CtrlVcuHevPxDischrgLmtBpt = [0 0.5 0.7 0.9 1 1 1 1 1 1 1]
CtrlVcuHevPxBattCurrMax = 150
CtrlVcuHevPxBattChrgPwrMax = -30000
CtrlVcuHevPxBattDischrgPwrMax = 46000
CtrlVcuHevPxAdaptECMSKpGain = 3
CtrlVcuHevPxAdaptECMSKiGain = 0.1
CtrlVcuHevPxSocBpt = [0 0.1 0.2 0.3 0.4 0.5 0.6 0.7 0.8 0.9 1]
CtrlVcuHevPxRegenBrkCutOff = [0 1]
CtrlVcuHevP1ECMSs = 4.464372
CtrlVcuHevP2ECMSs = 4.308011
CtrlVcuHevP3ECMSs = 3.955396
CtrlVcuHevP4ECMSs = 3.5268309
CtrlVcuHevP0ECMSs = 2.228167